% Requirement links of HydroPowertest.slx (R2024b)

block :252 implements Data__MOTOR.m#@739581.620.1: CurrentFaultSwitch
block :296 implements Data__MOTOR.m#@739581.620.1: CurrentFaultSwitch
block :316 implements Data__MOTOR.m#@739581.620.1: CurrentFaultSwitch